# Grasshopper definition CrossMesh.gh (Grasshopper 1.0.7)
# plug-ins: TopoGrasshopper Info

mesh = Mesh(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)
# Set CrossMesh
inittopo = InitTopo(Reset=Button())
faceb = FaceBoundaries(Mesh=mesh)
modifycrossmesh = ModifyCrossMesh(TopoPtr=inittopo, Parts=faceb)

modifypara = ModifyPara(APointerOfTopoCreator=modifycrossmesh, Name="tiltAngle", Value=Slider(35, range=0..80))
# Set Parameters
modifypara_2 = ModifyPara(APointerOfTopoCreator=modifypara, Name="cutUpper", Value=Slider(0.02, range=0..0.2))
modifypara_3 = ModifyPara(APointerOfTopoCreator=modifypara_2, Name="cutLower", Value=Slider(0.02, range=0..0.2))

drawstructure = DrawStructure(TopoPtr=modifypara_3, Preview=Toggle(True))  # -> Part, Boundary
rgb = ColourRGB(Alpha="150", Red="150", Green="150", Blue="150")
rgb_2 = ColourRGB(Alpha="250", Red="250", Green="250", Blue="250")
# Render Mesh
pt = Point(Point(2.5, 0, 0))
material = CreateMaterial(Diffuse=rgb, Specular=rgb, Emission=rgb, Transparency=0, Shine=0)
material_2 = CreateMaterial(Diffuse=rgb_2, Specular=rgb_2, Emission=rgb_2, Transparency=0, Shine=0)
move = Move(Geometry=drawstructure.Part, Motion=pt)  # -> Geometry, Transform
move_2 = Move(Geometry=drawstructure.Boundary, Motion=pt)  # -> Geometry, Transform
wireframe = FaceBoundaries(Mesh=[move.Geometry, move_2.Geometry])
boundary = CustomPreview(Geometry=move_2.Geometry, Material=material)
part = CustomPreview(Geometry=move.Geometry, Material=material_2)
