# Grasshopper definition ghexample.gh (Grasshopper 1.0.7)
# plug-ins: TopoGrasshopper Info

pwd = VBScript()  # -> out, Path
# ---------- pwd: VB ----------
    Dim gh_d As GH_Document = owner.OnPingDocument()

    If gh_d.IsFilePathDefined Then
      Print("A path is defined.")
      Path = gh_d.FilePath
    Else
      Print("No path defined.")
    End If
# ---------- end pwd ----------
pwd_2 = VBScript()  # -> out, Path; same code as pwd
relative_exact = GhPythonScript(A=pwd.Path, B="model/fig_teaser/origin.xml")  # -> Path
# ---------- relative_exact: Python ----------
__author__ = "ziqwang"

import rhinoscriptsyntax as rs

import os

Path = os.path.join(os.path.dirname(A), os.path.normpath(B))
# ---------- end relative_exact ----------
relative_exact_2 = GhPythonScript(A=pwd_2.Path, B="model/fig_intro_sphere/SphereA80_Quad_T0.08.xml")  # -> Path; same code as relative_exact
topoxmlreader = TopoXMLReader(XMLFile=relative_exact_2)
topoxmlreader_2 = TopoXMLReader(XMLFile=relative_exact)

modifypara = ModifyPara(APointerOfTopoCreator=topoxmlreader, Name="tiltAngle", Value=Slider(39, range=0..80))
modifypara_2 = ModifyPara(APointerOfTopoCreator=topoxmlreader_2, Name="tiltAngle", Value=Slider(41, range=0..80))
modifypara_3 = ModifyPara(APointerOfTopoCreator=modifypara, Name="cutUpper", Value=Slider(0.1, range=0..0.2))
modifypara_4 = ModifyPara(APointerOfTopoCreator=modifypara_2, Name="cutUpper", Value=Slider(0.054, range=0..0.2))
modifypara_5 = ModifyPara(APointerOfTopoCreator=modifypara_3, Name="cutLower", Value=Slider(0.091, range=0..0.2))
modifypara_6 = ModifyPara(APointerOfTopoCreator=modifypara_4, Name="cutLower", Value=Slider(0.083, range=0..0.2))
modifypara_7 = ModifyPara(APointerOfTopoCreator=modifypara_5, Name="patternAngle", Value=Slider(-2.7, range=-20..20))
modifypara_8 = ModifyPara(APointerOfTopoCreator=modifypara_6, Name="patternAngle", Value=Slider(-2.9, range=-20..20))
modifypara_9 = ModifyPara(APointerOfTopoCreator=modifypara_7, Name="patternScale", Value=Slider(1.1, range=0..2))
modifypara_10 = ModifyPara(APointerOfTopoCreator=modifypara_8, Name="patternScale", Value=Slider(1, range=0..2))

toggle = BooleanToggle(True)
drawstructure = DrawStructure(TopoPtr=modifypara_9, Preview=toggle)  # -> NumberOfPart, Meshes
drawstructure_2 = DrawStructure(TopoPtr=modifypara_10, Preview=toggle)  # -> NumberOfPart, Meshes
pt = Point(Point(2.5, 0, 0))
move = Move(Geometry=drawstructure.Meshes, Motion=pt)  # -> Geometry, Transform
rgb = ColourRGB(Alpha="250", Red="250", Green="250", Blue="250")
material = CreateMaterial(Diffuse=rgb, Specular=rgb, Emission=rgb, Transparency=0, Shine=0)
preview = CustomPreview(Geometry=move.Geometry, Material=material)
faceb = FaceBoundaries(Mesh=[move.Geometry, drawstructure_2.Meshes])
preview_2 = CustomPreview(Geometry=drawstructure_2.Meshes, Material=material)
