# Grasshopper definition test.gh (Grasshopper 1.0.7)
# plug-ins: TopoGrasshopper Info

number_slider = Slider(40, range=0..100)
number_slider_2 = Slider(0.06, range=0..1)
mesh = Mesh(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)
inittopo = InitTopo()
tri = Triangulate(Mesh=mesh)  # -> Mesh, Count
modifyreferencemesh = ModifyReferenceMesh(APointerOfTopoCreator=inittopo, ReferenceMesh=tri.Mesh)
hexgrid = Hexagonal(Plane=PlaneXY(0, 0, 0), Size=number_slider_2, ExtentX=number_slider, ExtentY=number_slider)  # -> flatten(Cells), flatten(Points)
sqgrid = Square(Plane=PlaneXY(0, 0, 0), Size=number_slider_2, ExtentX=number_slider, ExtentY=number_slider)  # -> flatten(Cells), flatten(Points)
crv = Curve(sqgrid.Cells)
python = GhPythonScript(Pts=sqgrid.Points)  # -> ct; inputs Pts: list of Point3d
# ---------- python: Python ----------
__author__ = "ziqwang"

import rhinoscriptsyntax as rs

ct = rs.CreatePoint(0, 0, 0)
for pt in Pts:
    ct = ct + pt
    
ct /= -len(Pts)
# ---------- end python ----------
move = Move(Geometry=crv, Motion=python)  # -> flatten(Geometry), Transform
modifypattern = ModifyPattern(APointerOfTopoCreator=modifyreferencemesh, PatternLine=move.Geometry)
modifypara = ModifyPara(APointerOfTopoCreator=modifypattern, Name="patternScale", Value=Slider(1, range=0..5))
modifypara_2 = ModifyPara(APointerOfTopoCreator=modifypara, Name="cutLower", Value=Slider(0.02, range=0..5))
modifypara_3 = ModifyPara(APointerOfTopoCreator=modifypara_2, Name="cutUpper", Value=Slider(0.02, range=0..5))
modifypara_4 = ModifyPara(APointerOfTopoCreator=modifypara_3, Name="patternAngle", Value=Slider(20, range=-180..180))
draw2dtexturemesh = Draw2DTextureMesh(TopoPtr=modifypara_4)
drawpatternmesh = DrawPatternMesh(TopoPtr=modifypara_4)
drawbasemesh2d = DrawBaseMesh2D(TopoPtr=modifypara_4)
drawstructure = DrawStructure(TopoPtr=modifypara_4, Preview=Toggle(True))  # -> Part, Boundary
drawcrossmesh = DrawCrossMesh(TopoPtr=modifypara_4)
